% Simulink data dictionary ITiremyDictionary.sldd

pGain1 = mpt.Parameter(0, StorageClass="ExportedGlobal", DataType="uint8")
pTirePrsLostCountTh = mpt.Parameter(5400, StorageClass="ExportedGlobal", DataType="double")
pTireHighPreUpLimit = mpt.Parameter(350, StorageClass="ExportedGlobal", DataType="double", Unit="kPa")
Var = 0
TireRFPrs = mpt.Signal(StorageClass="ExportedGlobal", DataType="uint16", InitialValue="0")
ABSAtv = mpt.Signal(StorageClass="ExportedGlobal", DataType="uint8", InitialValue="0")
ABSFld = mpt.Signal(StorageClass="ExportedGlobal", DataType="uint8", InitialValue="0")
AccActPos = mpt.Signal(StorageClass="ExportedGlobal", DataType="uint8", InitialValue="0")
AccActPosV = mpt.Signal(StorageClass="ExportedGlobal", DataType="uint8", InitialValue="0")
AutoTransComndGear = mpt.Signal(StorageClass="ExportedGlobal", DataType="uint8", InitialValue="0")
BrkPdlPos = mpt.Signal(StorageClass="ExportedGlobal", DataType="uint8", InitialValue="0")
CldrDay_154 = mpt.Signal(StorageClass="ExportedGlobal", DataType="uint8", InitialValue="0")
CldrMth_154 = mpt.Signal(StorageClass="ExportedGlobal", DataType="uint8", InitialValue="0")
CldrYr_154 = mpt.Signal(StorageClass="ExportedGlobal", DataType="uint16", InitialValue="0")
CmpsCrhding = mpt.Signal(StorageClass="ExportedGlobal", DataType="uint16", InitialValue="0")
CmpsOctHding = mpt.Signal(StorageClass="ExportedGlobal", DataType="uint8", InitialValue="0")
DrvEconMdCmd = mpt.Signal(StorageClass="ExportedGlobal", DataType="uint8", InitialValue="0")
DrvHldMdCmnd = mpt.Signal(StorageClass="ExportedGlobal", DataType="uint8", InitialValue="0")
DrvSprtMdCmd = mpt.Signal(StorageClass="ExportedGlobal", DataType="uint8", InitialValue="0")
DrvMntnMdCmnd = mpt.Signal(StorageClass="ExportedGlobal", DataType="uint8", InitialValue="0")
DrvTwHaulMdCmd = mpt.Signal(StorageClass="ExportedGlobal", DataType="uint8", InitialValue="0")
DrvWntrMdCmd = mpt.Signal(StorageClass="ExportedGlobal", DataType="uint8", InitialValue="0")
EngActStdyStTorq = mpt.Signal(StorageClass="ExportedGlobal", DataType="double", InitialValue="0")
EngActStdyStTorqV = mpt.Signal(StorageClass="ExportedGlobal", DataType="uint8")
EngRunAtv = mpt.Signal(StorageClass="ExportedGlobal", DataType="uint8", InitialValue="0")
Hrs = mpt.Signal(StorageClass="ExportedGlobal", DataType="uint8", InitialValue="0")
HrsV = mpt.Signal(StorageClass="ExportedGlobal", DataType="uint8", InitialValue="0")
LatAccSnsVal = mpt.Signal(StorageClass="ExportedGlobal", DataType="double", InitialValue="0")
LFTirePreStaus = mpt.Signal(StorageClass="ExportedGlobal", DataType="uint8", InitialValue="0")
LFTireTempStaus = mpt.Signal(StorageClass="ExportedGlobal", DataType="uint8", InitialValue="0")
LFTirPreSenLostErr = mpt.Signal(StorageClass="ExportedGlobal", DataType="uint8", InitialValue="0")
LFTirPreSenLostErrV = mpt.Signal(StorageClass="ExportedGlobal", DataType="uint8", InitialValue="0")
LonAccSnsVal = mpt.Signal(StorageClass="ExportedGlobal", DataType="double", InitialValue="0")
LRTireLeakStaus = mpt.Signal(StorageClass="ExportedGlobal", DataType="uint8", InitialValue="0")
LRTirePreStaus = mpt.Signal(StorageClass="ExportedGlobal", DataType="uint8", InitialValue="0")
LRTireTempStaus = mpt.Signal(StorageClass="ExportedGlobal", DataType="uint8", InitialValue="0")
LRTirPreSenLostErr = mpt.Signal(StorageClass="ExportedGlobal", DataType="uint8", InitialValue="0")
LRTirPreSenLostErrV = mpt.Signal(StorageClass="ExportedGlobal", DataType="uint8", InitialValue="0")
Mins = mpt.Signal(StorageClass="ExportedGlobal", DataType="uint8", InitialValue="0")
MinsV = mpt.Signal(StorageClass="ExportedGlobal", DataType="uint8", InitialValue="0")
OtsAirTmp = mpt.Signal(StorageClass="ExportedGlobal", DataType="double", InitialValue="0")
OtsAirTmpV = mpt.Signal(StorageClass="ExportedGlobal", DataType="uint8", InitialValue="0")
PsngSysLat = mpt.Signal(StorageClass="ExportedGlobal", DataType="int32", InitialValue="0")
PsngSysLatV = mpt.Signal(StorageClass="ExportedGlobal", DataType="uint8", InitialValue="0")
PsngSysLong = mpt.Signal(StorageClass="ExportedGlobal", DataType="int32", InitialValue="0")
PsngSysLongV = mpt.Signal(StorageClass="ExportedGlobal", DataType="uint8", InitialValue="0")
RFTireLeakStaus = mpt.Signal(StorageClass="ExportedGlobal", DataType="uint8", InitialValue="0")
RFTirePreStaus = mpt.Signal(StorageClass="ExportedGlobal", DataType="uint8", InitialValue="0")
RFTireTempStaus = mpt.Signal(StorageClass="ExportedGlobal", DataType="uint8", InitialValue="0")
RFTirPreSenLostErr = mpt.Signal(StorageClass="ExportedGlobal", DataType="uint8", InitialValue="0")
RFTirPreSenLostErrV = mpt.Signal(StorageClass="ExportedGlobal", DataType="uint8", InitialValue="0")
RnSnsActIO = mpt.Signal(StorageClass="ExportedGlobal", DataType="uint8", InitialValue="0")
RnSnsOffIO = mpt.Signal(StorageClass="ExportedGlobal", DataType="uint8", InitialValue="0")
RRTireLeakStaus = mpt.Signal(StorageClass="ExportedGlobal", DataType="uint8", InitialValue="0")
RRTirePreStaus = mpt.Signal(StorageClass="ExportedGlobal", DataType="uint8", InitialValue="0")
RRTireTempStaus = mpt.Signal(StorageClass="ExportedGlobal", DataType="uint8", InitialValue="0")
RRTirPreSenLostErr = mpt.Signal(StorageClass="ExportedGlobal", DataType="uint8", InitialValue="0")
RRTirPreSenLostErrV = mpt.Signal(StorageClass="ExportedGlobal", DataType="uint8", InitialValue="0")
Sec = mpt.Signal(StorageClass="ExportedGlobal", DataType="uint8", InitialValue="0")
SecV = mpt.Signal(StorageClass="ExportedGlobal", DataType="uint8", InitialValue="0")
StrWhAng = mpt.Signal(StorageClass="ExportedGlobal", DataType="int16", InitialValue="0")
StrWhAngGrd = mpt.Signal(StorageClass="ExportedGlobal", DataType="int16", InitialValue="0")
StrWhAngGrdV = mpt.Signal(StorageClass="ExportedGlobal", DataType="uint8", InitialValue="0")
StrWhAngV = mpt.Signal(StorageClass="ExportedGlobal", DataType="uint8", InitialValue="0")
TCSysAtv = mpt.Signal(StorageClass="ExportedGlobal", DataType="uint8", InitialValue="0")
TCSysEnbld = mpt.Signal(StorageClass="ExportedGlobal", DataType="uint8", InitialValue="0")
ThrPos = mpt.Signal(StorageClass="ExportedGlobal", DataType="uint8", InitialValue="0")
ThrPosV = mpt.Signal(StorageClass="ExportedGlobal", DataType="uint8", InitialValue="0")
TireLFPrs = mpt.Signal(StorageClass="ExportedGlobal", DataType="uint16", InitialValue="0")
TireLFPrsV = mpt.Signal(StorageClass="ExportedGlobal", DataType="uint8", InitialValue="0")
TireLFTmp = mpt.Signal(StorageClass="ExportedGlobal", DataType="int16", InitialValue="0")
TireLFTmpV = mpt.Signal(StorageClass="ExportedGlobal", DataType="uint8", InitialValue="0")
TireLRPrs = mpt.Signal(StorageClass="ExportedGlobal", DataType="uint16", InitialValue="0")
TireLRPrsV = mpt.Signal(StorageClass="ExportedGlobal", DataType="uint8", InitialValue="0")
TireLRTmp = mpt.Signal(StorageClass="ExportedGlobal", DataType="int16", InitialValue="0")
TireLRTmpV = mpt.Signal(StorageClass="ExportedGlobal", DataType="uint8", InitialValue="0")
TireRFPrsV = mpt.Signal(StorageClass="ExportedGlobal", DataType="uint8", InitialValue="0")
TireRFTmp = mpt.Signal(StorageClass="ExportedGlobal", DataType="int16", InitialValue="0")
TireRFTmpV = mpt.Signal(StorageClass="ExportedGlobal", DataType="uint8", InitialValue="0")
TireRRPrs = mpt.Signal(StorageClass="ExportedGlobal", DataType="uint16", InitialValue="0")
TireRRPrsV = mpt.Signal(StorageClass="ExportedGlobal", DataType="uint8", InitialValue="0")
TireRRTmp = mpt.Signal(StorageClass="ExportedGlobal", DataType="int16", InitialValue="0")
TireRRTmpV = mpt.Signal(StorageClass="ExportedGlobal", DataType="uint8", InitialValue="0")
TurnWprIntIO = mpt.Signal(StorageClass="ExportedGlobal", DataType="uint8", InitialValue="0")
VehDynYawRate = mpt.Signal(StorageClass="ExportedGlobal", DataType="double", InitialValue="0")
VehDynYawRateV = mpt.Signal(StorageClass="ExportedGlobal", DataType="uint8", InitialValue="0")
VehOdo = mpt.Signal(StorageClass="ExportedGlobal", DataType="uint32", InitialValue="0")
VehOdoV = mpt.Signal(StorageClass="ExportedGlobal", DataType="uint8", InitialValue="0")
VehSpdAvgNDrvn = mpt.Signal(StorageClass="ExportedGlobal", DataType="double", InitialValue="0")
VehSpdAvgNDrvnV = mpt.Signal(StorageClass="ExportedGlobal", DataType="uint8", InitialValue="0")
VSEAct = mpt.Signal(StorageClass="ExportedGlobal", DataType="uint8", InitialValue="0")
VSELatAcc = mpt.Signal(StorageClass="ExportedGlobal", DataType="double", InitialValue="0")
VSELatAccV = mpt.Signal(StorageClass="ExportedGlobal", DataType="uint8", InitialValue="0")
WSWprAct = mpt.Signal(StorageClass="ExportedGlobal", DataType="uint8", InitialValue="0")
pTireHighPreDWLimit = mpt.Parameter(335, StorageClass="ExportedGlobal", DataType="double", Unit="kPa")
pTireLowPreUpLimit = mpt.Parameter(195, StorageClass="ExportedGlobal", DataType="double", Unit="kPa")
pTireLowPreDWLimit = mpt.Parameter(180, StorageClass="ExportedGlobal", DataType="double", Unit="kPa")
LFTireLeakStaus = mpt.Signal(StorageClass="ExportedGlobal", DataType="uint8", InitialValue="0")
TireSlowLifeLF = mpt.Signal(StorageClass="ExportedGlobal", DataType="uint8")
TireSlowLifeLR = mpt.Signal(StorageClass="ExportedGlobal", DataType="uint8")
TireSlowLifeRF = mpt.Signal(StorageClass="ExportedGlobal", DataType="uint8")
TireSlowLifeRR = mpt.Signal(StorageClass="ExportedGlobal", DataType="uint8")